# Grasshopper definition Components.gh (Grasshopper 1.0.8)
# plug-ins: eleFront, Swiftlet

param = DefineToolParameter(Name="point_b", Type="string", Description="end point for bridge generation formatted as \"x, y, z\"", Required=True)
param_2 = DefineToolParameter(Name="point_a", Type="string", Description="start point for bridge generation formatted as \"x, y, z\"", Required=True)
panel = Panel("generates a representation of a bridge between two points, based on an input width")
panel_2 = Panel("gets the current outlines of the massing that lives in the Rhino model and finds the center points")
merge = Merge(Data1=param_2, Data2=param)
tool = DefineTool(Name="get_massing_centers", Description=panel_2)
tool_2 = DefineTool(Name="create_bridge", Description=panel, Parameters=merge)
merge_2 = Merge(Data1=tool_2, Data2=tool)
mcp = MCPServer(Port=3001, Tools=merge_2, ServerName="DAVE")  # -> Create_bridge, Get_massing_centers

decall = DeconstructToolCall(Request=mcp.Create_bridge)  # -> Request, Tool, Arguments
gjok = GetJSONObjectKey(JObject=decall.Arguments, Key="point_a")
gjok_2 = GetJSONObjectKey(JObject=decall.Arguments, Key="point_b")
rjv = ReadJSONValue(JValue=gjok)  # -> AsString, AsNumber, AsBool
rjv_2 = ReadJSONValue(JValue=gjok_2)  # -> AsString, AsNumber, AsBool
split = TextSplit(Text=rjv.AsString, Separators=",")
split_2 = TextSplit(Text=rjv_2.AsString, Separators=",")
trim = TextTrim(Text=split, Start=True, End=True)
trim_2 = TextTrim(Text=split_2, Start=True, End=True)
item = ListItem(List=trim, Index=1, Wrap=True)
item_2 = ListItem(List=trim, Index=2, Wrap=True)
item_3 = ListItem(List=trim, Index=0, Wrap=True)
item_4 = ListItem(List=trim_2, Index=1, Wrap=True)
item_5 = ListItem(List=trim_2, Index=2, Wrap=True)
item_6 = ListItem(List=trim_2, Index=0, Wrap=True)
pt = ConstructPoint(XCoordinate=item_3, YCoordinate=item, ZCoordinate=item_2)
pt_2 = ConstructPoint(XCoordinate=item_6, YCoordinate=item_4, ZCoordinate=item_5)

py3 = Python3Script(prefix="bridge")  # -> random_id; inputs prefix: String
# ---------- py3: Python ----------
import random

id = random.randint(1000000, 9999999)
random_id = f"{prefix}-{id}"
# ---------- end py3 ----------
null = NullItem(Item=decall.Request)  # -> NullFlags, InvalidFlags, Description
not = GateNot(A=null.NullFlags)
bridge_name = Panel(py3)
bool = Boolean(not)

# ----
# Connectivity
geo = Geometry([<curve referenced from the Rhino model> x9])

# ---- group: Checks if closed curve
area = Area(Geometry=geo)  # -> Area, Centroid
null_2 = NullItem(Item=area.Area)  # -> NullFlags, InvalidFlags, Description
dispatch = Dispatch(List=geo, DispatchPattern=null_2.NullFlags)  # -> ListA, ListB

# ----
rhatt = GetRhinoAttributes(Geometry=dispatch.ListB, fullpath=False)  # -> Name, Layer, Color, MaterialName, SourceFile
cset = CreateSet(List=rhatt.Color)  # -> Set, Map
tstat = TreeStatistics(Tree=cset.Set)  # -> Paths, Length, Count
area_2 = Area(Geometry=dispatch.ListB)  # -> Area, Centroid
series = Series(Start=0, Step=1, Count=tstat.Length)
associated_color_index = Data(series)
py3_2 = Python3Script(Pts=area_2.Centroid, IDs=rhatt.Name, Index=cset.Map)  # -> out, Distance, Connection, FromID, ToID, FromIndex, ToIndex, PairLabel, Notes; inputs Pts: list of Point3d, IDs: list of String, Index: list of Int32
# ---------- py3_2: Python ----------
"""
Grasshopper Python Script

Purpose:
    Calculates the distance between each unique pair of input points.

    Each point/object has:
        1. A point location
        2. An identification number
        3. An associated index, such as a color/category index

    The script keeps track of both objects involved in each connection.

Inputs:
    Pts   : List of points
    IDs   : List of identification numbers, one per point
    Index : List of associated index/color/category values, one per point

Outputs:
    Distance  : Distance between each unique point pair
    Connection: Line between each unique point pair
    FromID    : ID of the first object in the pair
    ToID      : ID of the second object in the pair
    FromIndex : Associated index of the first object in the pair
    ToIndex   : Associated index of the second object in the pair
    PairLabel : Readable label describing each connection
    Notes     : Error/warning/status messages
"""

import Rhino.Geometry as rg


# ------------------------------------------------------------
# Helper functions
# ------------------------------------------------------------

def flatten_input(data):
    """
    Converts Grasshopper input into a simple Python list.

    This lets the script work with:
        - single items
        - normal lists
        - tuples
        - Grasshopper DataTrees
    """

    if data is None:
        return []

    if isinstance(data, list) or isinstance(data, tuple):
        return list(data)

    if hasattr(data, "Branches"):
        flattened = []

        for branch in data.Branches:
            for item in branch:
                flattened.append(item)

        return flattened

    return [data]


def get_point3d(item):
    """
    Converts common Grasshopper/Rhino point-like inputs into Point3d.

    Supported input types:
        - Rhino.Geometry.Point3d
        - Rhino.Geometry.Point, using its Location property
    """

    if item is None:
        return None

    if isinstance(item, rg.Point3d):
        return item

    if isinstance(item, rg.Point):
        return item.Location

    if hasattr(item, "Location") and isinstance(item.Location, rg.Point3d):
        return item.Location

    return None


# ------------------------------------------------------------
# Default outputs
# ------------------------------------------------------------

Distance = []
Connection = []
FromID = []
ToID = []
FromIndex = []
ToIndex = []
PairLabel = []
Notes = []


# ------------------------------------------------------------
# Normalize inputs
# ------------------------------------------------------------

pts_input = flatten_input(Pts)
ids_input = flatten_input(IDs)
index_input = flatten_input(Index)


# ------------------------------------------------------------
# Validate inputs
# ------------------------------------------------------------

if len(pts_input) == 0:
    Notes.append("Error: No points were provided.")

elif len(ids_input) == 0:
    Notes.append("Error: No IDs were provided.")

elif len(index_input) == 0:
    Notes.append("Error: No Index values were provided.")

elif len(pts_input) != len(ids_input):
    Notes.append(
        "Error: Number of points does not match number of IDs. "
        "Points: {0}, IDs: {1}".format(len(pts_input), len(ids_input))
    )

elif len(pts_input) != len(index_input):
    Notes.append(
        "Error: Number of points does not match number of Index values. "
        "Points: {0}, Index values: {1}".format(len(pts_input), len(index_input))
    )

else:
    points = []
    ids = []
    indices = []

    invalid_point_indices = []

    for i in range(len(pts_input)):
        pt = get_point3d(pts_input[i])

        if pt is None:
            invalid_point_indices.append(i)
        else:
            points.append(pt)
            ids.append(ids_input[i])
            indices.append(index_input[i])

    if len(invalid_point_indices) > 0:
        Notes.append(
            "Error: Invalid point input found at item index/indices: {0}".format(
                invalid_point_indices
            )
        )

    elif len(points) < 2:
        Notes.append(
            "Error: At least two valid points are required to calculate distances."
        )

    else:
        count = len(points)

        # ------------------------------------------------------------
        # Calculate unique unordered pairs
        #
        # This avoids:
        #   - self-distances, such as 1-1
        #   - duplicate reverse pairs, such as 1-2 and 2-1
        #
        # Example for four objects:
        #   1-2
        #   1-3
        #   1-4
        #   2-3
        #   2-4
        #   3-4
        # ------------------------------------------------------------

        for i in range(count):
            for j in range(i + 1, count):

                pt_a = points[i]
                pt_b = points[j]

                id_a = ids[i]
                id_b = ids[j]

                index_a = indices[i]
                index_b = indices[j]

                dist = pt_a.DistanceTo(pt_b)
                line = rg.Line(pt_a, pt_b)

                Distance.append(dist)
                Connection.append(line)

                FromID.append(id_a)
                ToID.append(id_b)

                FromIndex.append(index_a)
                ToIndex.append(index_b)

                PairLabel.append(
                    "ID {0} | Index {1}  <-->  ID {2} | Index {3} | Distance {4}".format(
                        id_a,
                        index_a,
                        id_b,
                        index_b,
                        round(dist, 4)
                    )
                )

        expected_connection_count = count * (count - 1) / 2

        Notes.append(
            "Success: Calculated {0} unique connections from {1} input objects.".format(
                len(Distance),
                count
            )
        )

        Notes.append(
            "Expected unique pair count: {0}.".format(
                int(expected_connection_count)
            )
        )

        Notes.append(
            "Self-distances and duplicate reverse pairs were automatically excluded."
        )
# ---------- end py3_2 ----------
color = Data(cset.Set)

# ----
# Create Bridge (Point A to Point B)
number_slider = Slider(2, range=0..10)
bridge_width = Number(number_slider)
point_a = Point(pt)
point_b = Point(pt_2)
ln = Line(StartPoint=point_a, EndPoint=point_b)  # -> simplify(Line)
panel_3 = Panel("""0
1""")
pframe = PerpFrame(Curve=reparameterize(ln), Parameter=panel_3)
deplane = DeconstructPlane(Plane=pframe)  # -> Origin, XAxis, YAxis, ZAxis

# ---- group: Perp Vector Road Width
multiplication = Multiplication(A=bridge_width, B=deplane.YAxis)
multiplication_2 = Multiplication(A=bridge_width, B=deplane.YAxis)  # -> simplify(graft(Result))
multiplication_3 = Multiplication(A=multiplication, B=-1)  # -> simplify(graft(Result))

# ---- group: Bridge Width
merge_3 = Merge(Data1=point_a, Data2=point_b)  # -> graft(Result)
move = Move(Geometry=merge_3, Motion=[multiplication_2, multiplication_3])  # -> Geometry, Transform
flip = FlipMatrix(Data=move.Geometry)

# ----
intcrv = Interpolate(Vertices=move.Geometry, Degree=3, Periodic=False, KnotStyle=1)  # -> Curve, Length, Domain
intcrv_2 = Interpolate(Vertices=flip, Degree=3, Periodic=False, KnotStyle=1)  # -> Curve, Length, Domain
join = JoinCurves(Curves=flatten([intcrv_2.Curve, intcrv.Curve]), Preserve=False)  # -> simplify(Curves)
boundary = BoundarySurfaces(Edges=join)

# ---- group: Bridge Surfaces
geo_2 = Geometry(boundary)

# ----
py3_3 = Python3Script(geometry=geo_2, name=bridge_name, bake=bool)  # -> result, error; inputs geometry: GeometryBase, name: String, bake: Boolean
# ---------- py3_3: Python ----------
import Rhino
import scriptcontext as sc
import System
import json

if bake:
    error = True
    sc.doc = Rhino.RhinoDoc.ActiveDoc

    # Get or create the DAVE_OUT_BRIDGES layer
    layer_name = "DAVE_OUT_BRIDGES"
    layer_index = sc.doc.Layers.FindByFullPath(layer_name, -1)
    if layer_index == -1:
        new_layer = Rhino.DocObjects.Layer()
        new_layer.Name = layer_name
        layer_index = sc.doc.Layers.Add(new_layer)

    # Bake with layer assigned
    attr = Rhino.DocObjects.ObjectAttributes()
    attr.LayerIndex = layer_index
    obj_id = sc.doc.Objects.Add(geometry, attr)

    if obj_id != System.Guid.Empty:
        obj = sc.doc.Objects.Find(obj_id)
        if obj:
            attr = obj.Attributes.Duplicate()
            attr.Name = name
            sc.doc.Objects.ModifyAttributes(obj_id, attr, True)

            bbox = obj.Geometry.GetBoundingBox(True)
            geo_type = obj.Geometry.GetType().Name
            result = json.dumps({
                "name": name,
                "type": geo_type,
                "id": str(obj_id)   # <-- pass GUID back to MCP
            })
            error = False
        else:
            result = json.dumps({"err": "Object not found after add"})
        sc.doc.Views.Redraw()
    else:
        result = json.dumps({"err": "Failed to bake geometry"})
    sc.doc = ghdoc
else:
    result = json.dumps({"msg": "Bake is False, skipping"})
    error = False
# ---------- end py3_3 ----------
pjs = ParseJSONString(Text=py3_3.result)
response = Panel(py3_3.result)
mcp_txt = CreateMCPTextContent(Text=pjs)
respond = MCPToolResponse(Request=decall.Request, ContentBlocks=mcp_txt, IsError=py3_3.error)

# ----
# Get Massing Centers
decall_2 = DeconstructToolCall(Request=mcp.Get_massing_centers)  # -> Request, Tool, Arguments
pipeline = GeometryPipeline(
    GroupByLayer=False,
    GroupByType=False,
    IncludeHidden=True,
    IncludeLocked=True,
    LayerFilter="Default",
    NameFilter="*",
    SublayerFiltering=True,
    TypeFilter=4)
geo_3 = Geometry(pipeline)
cls = Closed(Curve=geo_3)  # -> Closed, Periodic
cull = CullPattern(List=geo_3, CullPattern=cls.Closed)
area_3 = Area(Geometry=cull)  # -> Area, Centroid
panel_4 = Panel(area_3.Centroid)

cjv = CreateJSONValue(Value=panel_4)
cjo = CreateJSONObject(Keys=panel_4, Values=cjv)
sjt = StringifyJSONToken(JToken=cjo)
mcp_txt_2 = CreateMCPTextContent(Text=sjt)

respond_2 = MCPToolResponse(Request=decall_2.Request, ContentBlocks=mcp_txt_2, IsError=False)
